vi "Application Directory.gvi"   [LabVIEW NXG 2.0.0]
# Returns the LV App directory + Relative path.
inputs:
  "Relative path (.)": path = path "."
outputs:
  "Application Directory (+ Relative)": path
diagram:
  Property Node[IsPlaceholderNodeForConversion=True]() -> ("Execution State"=w1)
  Build Path(base path=w1, name or relative path=$"Relative path (.)") -> (appended path=w2)
  $"Application Directory (+ Relative)" <- w2
