vi "VI Library.gvi"   [LabVIEW NXG 2.0.0]
# Returns the LV VI Library directory (vi.lib) + Relative path.
inputs:
  "Relative path (.)": path = path "."
outputs:
  "VI Library (+ Relative)": path
diagram:
  VILibrary() -> (path Output 0=w1)  # VILibrary (Placeholder)
  Build Path(base path=w1, name or relative path=$"Relative path (.)") -> (appended path=w2)
  $"VI Library (+ Relative)" <- w2
