vi "MD5 F function.gvi"   [LabVIEW NXG 2.0.0]
inputs:
  "X": u32
  "Y": u32
  "Z": u32
outputs:
  "F(X,Y,Z)": u32
diagram:
  Logical And($X, $Y) -> w1
  Not(x=$X) -> w2
  Logical And($Z, w2) -> w3
  Logical Or(w3, w1) -> w4
  $"F(X,Y,Z)" <- w4
