vi "MD5 G function.gvi"   [LabVIEW NXG 2.0.0]
inputs:
  "X": u32
  "Y": u32
  "Z": u32
outputs:
  "G(X,Y,Z)": u32
diagram:
  Logical And($X, $Z) -> w1
  Not(x=$Z) -> w2
  Logical And(w2, $Y) -> w3
  Logical Or(w1, w3) -> w4
  $"G(X,Y,Z)" <- w4
