vi "Coerce to Enum.gvi"   [LabVIEW NXG 2.0.0]
# This is a merged VI which will place appropriate code for coersion from numeric to an enum
diagram:
  # >> Enum Def >>
  #                        V
  #                        V
  # >> Numeric >>
  To Variant() -> w1
  # >> Enum >>
  Variant To Data(variant=w1)
