vi "VI Tree - numeric.gvi"   [LabVIEW Platform Developer Preview 0.1.0]
uses:
  openg::library::numeric::Random Number Within Range - DBL.gvi
  openg::library::numeric::Coerce to Enum.gvi
  openg::library::numeric::Timestamp Constant.gvi
diagram:
  call "Random Number Within Range - DBL.gvi"(High=1, Low=0)  # Random Number - Within Range
  call "Coerce to Enum.gvi"()
  call "Timestamp Constant.gvi"()
